# Grasshopper definition Csvreader.gh (Grasshopper 0.9.14)
# plug-ins: Python Interpreter

delimiter = Panel("|")
row_start = Panel("0")
row_end = Panel("9")
path = FilePath("C:\dhdacode\pruebas-2.csv")
quote = Panel("\"")
python = PythonScript()  # -> out, a, x
# ---------- python: Python ----------
import StringIO

file = open ("c:/dhdacode/pruebas-2.csv","r")
dataFile = file.read()


def display(header, rows):
    print header
    for row in rows:
        print ','.join(row)

f = StringIO.StringIO(dataFile)
# f simulates a file object as returned by the open() builtin.
heading = f.next().rstrip()
data = [line.rstrip().split('|') for line in f]

print data



# Sorting on the first column is boring -- it's already sorted.
# Let's sort on OperationName:
guff = data[:] # taking a copy
x = guff.sort(cmp=lambda x, y: cmp(x[2], y[2]))
#print "OperationName -- cmp"
a = display(heading, guff)


# Better [read the manual to find out why]
#guff = data[:] # taking a copy
#guff.sort(key=lambda x: x[2])
#print "OperationName -- key"
#display(heading, guff)

# simulate SQL: ORDER BY OperationName, Duration DESC
#guff = data[:] # taking a copy
#guff.sort( key=lambda x: (x[2], -float(x[5])))
#print "OperationName, Duration DESC -- key"
#display(heading, guff)
# ---------- end python ----------
csvfilereader = PythonScript(filePath=path, delimiter=delimiter, quote=quote, rowStart=row_start, rowEnd=row_end)  # -> out, csvRawData, csvHeader, headerFields, csvDataFields, graftedData; inputs rowStart: Int32, rowEnd: Int32
# ---------- csvfilereader: Python ----------
# COPYRIGHT NOTICE: 
# This script Its Developed By DHDA STUDIO
# The purpose of this script its to develop a Component that
# Handle CSV Files, and manage it like a Index Data Base 
# # Copyright for the Script by Toussaint Jimenez, 2012. 
# The library is licensed under DHDA-IT-CODE Open Source License.

# COPYRIGHT NOTICE: 
# This script uses the CSV reader by Sebastien Lorion 
# You can find his library including source code  
# at http://www.codeproject.com/cs/database/CsvReader.asp. 
# Copyright for the CSV library by Sbastien Lorion, 2005. 
# The library is licensed under MIT Open Source License. 


# Necessary imports to enable access to CSV reading component
import os
import sys
import clr
import System


from System import *

# for accesssing GH classes
clr.AddReference("Grasshopper")
from Grasshopper.Kernel.Data import GH_Path
from Grasshopper import DataTree

# Importation of the CSV Reader .Net Library By Sebastien Lorion
from System.Reflection import Assembly
assemblyPath = "C:\Program Files\Rhinoceros 5.0 Evaluation (64-bit)\Plug-ins\IronPython\Lib\csv_reader\LumenWorks.Framework.IO.dll"  #path of the CSV Reader By Sebastien Lorion, Change to yours path
assembly = Assembly.LoadFile(assemblyPath)
clr.AddReference(assembly)

from System.IO import StreamReader
from LumenWorks.Framework.IO.Csv import CsvReader
# End of Importation

#Create Operation for Open and reading CSV file 
csvFile = CsvReader(StreamReader(filePath), True) 
csvFile.SkipEmptyLines = True
#End of the Operation


#Create Operation Header
header = [csvFile.GetFieldHeaders()]                 # Retrieve the Csv Header
csvHeader = header[0]                                # Call the Header
headerstr = csvHeader[0]                             # release the Header from the internal Array
headerFields = headerstr.split(delimiter)       # List of the Fields in GH Data type
#End of the Operation


#Raw Csv Data
csvRawData = csvFile.GetCurrentRawData()
#End of the Operation

#Operation Data Csv File 
contentData = []
while csvFile.ReadNextRecord():
    contentCount = csvFile.FieldCount
    for i in range (contentCount):                       #Start Looping to Fill ContentData with CSV File RawData
        contentData.append(csvFile[i])


csvDataFields = contentData[rowStart:rowEnd]



#Operation for Graft The Data
newlist = []
newlist = csvDataFields[:]

graftedTree = DataTree[object]()
for i in range(len(newlist)):
    str =newlist[i]
    path = GH_Path(i)
    graftedTree.AddRange([str],path)

graftedData = graftedTree
#End of the Graft
# ---------- end csvfilereader ----------
panel = Panel(python.out)
csv_raw_data = Panel(csvfilereader.csvRawData)
csv_header = Panel(csvfilereader.csvHeader)
fields_headers = Panel(csvfilereader.headerFields)
csv_data_fields = Panel(csvfilereader.csvDataFields)
csv_data_fieds_grafted = Panel(csvfilereader.graftedData)
lng = ListLength(List=fields_headers)
series = Series(Start=0, Step=1, Count=lng)
item = ListItem(List=series, Index=Slider(1, range=0..13), Wrap=False)
int = Integer(item)
index_field_header = Panel(int)
split = StringSplit(String=csv_data_fieds_grafted, Separators=delimiter)
python_2 = PythonScript(headerFieldIndex=index_field_header, csvDataFields=csv_data_fields, delimiter=delimiter)  # -> out, xSortedList, sortedList; inputs csvDataFields: list
# ---------- python_2: Python ----------
# COPYRIGHT NOTICE: 
# This script Its Developed By DHDA STUDIO
# The purpose of this script its to develop a Component that
# Handle CSV Files, and manage it like a Index Data Base 
# # Copyright for the Script by Toussaint Jimenez, 2012. 
# The library is licensed under DHDA-IT-CODE Open Source License.

import os
import sys
import clr
import System
import StringIO
import math


# for accesssing GH classes
clr.AddReference("Grasshopper")
from Grasshopper.Kernel.Data import GH_Path
from Grasshopper import DataTree


#Variable Declaration and Casting Type
data = csvDataFields
index = (int(headerFieldIndex)+1) #Casting the Variable plus One to pass it in cmp sorted funtion

# Build a right list to be sorted by any Field
a = []
for i in data:
    splitData = i.split(',')
    for j in splitData:
        splitA = j.split(delimiter)
    a.append(splitA)

# Operation Sort by Index Field
xSortedList = sorted(a, cmp=lambda x, y: cmp(x[(index)], y[(index)]))

# Problem Here with the LIST IN LIST to a proper output to Grasshopper
sortedList = xSortedList




dataTree = DataTree[object]()

for i, thing in enumerate(data):

    sortedList = sortedLists[i]

    path = GH_Path(branch_id)

    dataTree.Add(thing, path)

a = dataTree









"""
fxSortedList = reduce(lambda x, y: x+y, xSortedList) #Flatterned List

n1 = len(data) # Length of data list
n2 = len(fxSortedList) #Length of Flatterned and Sorted List 
n = int(n2/n1)

sortedList = [fxSortedList[i:i+n] for i in range(0, n2, n)]

print sortedList
"""
# ---------- end python_2 ----------
panel_2 = Panel(python_2.out)
panel_3 = Panel(python_2.sortedList)
panel_4 = Panel(split)
